# Grasshopper definition vaild_offset.gh (Grasshopper 1.0.7)

number_slider = Slider(0.93, range=0..10)
Z = UnitZ(Factor=1)
crv = Curve(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)

# ---- group: 格林公式判断曲线是否为顺时针
divide = DivideCurve(Curve=crv, Count=10, Kinks=False)  # -> Points, Tangents, Parameters
cull_i = CullIndex(List=divide.Points, Indices="0", Wrap=True)
cull_i_2 = CullIndex(List=divide.Points, Indices="-1", Wrap=True)
pdecon = Deconstruct(Point=cull_i_2)  # -> XComponent, YComponent, ZComponent
pdecon_2 = Deconstruct(Point=cull_i)  # -> XComponent, YComponent, ZComponent
addition = Addition(A=pdecon_2.YComponent, B=pdecon.YComponent)
subtraction = Subtraction(A=pdecon_2.XComponent, B=pdecon.XComponent)
multiplication = Multiplication(A=addition, B=subtraction, C="-0.5")
ma = MassAddition(Input=multiplication)  # -> Result, PartialResults
expression = Expression(x=ma.Result, Expression="If(x ≤ 0, 1, -1)")

# ----
python = GhPythonScript()  # -> Curves, Count; inputs C: Curve, P: Plane
# ---------- python: Python ----------
'''
This compnent generates vaild offset polyline curves

Args:
    C: Curve
    D: Distance
    P: Plane
    A: Accraucy
Returns:
    Curves: Offset curves
    Count: The number of layer
'''

__author__ = "littlechao PC"
__version__ = "2023.12.30"

import rhinoscriptsyntax as rs
import Rhino.Geometry as rg
import ghpythonlib.components as gh
import ghpythonlib.treehelpers as th


def deivideAccuracy(A):
    accuracy = round(0.02 / A)
    if accuracy < 1:
        accuracy = 1
    return accuracy

def gereenEquation(pts): # this equation is to judge the direction of the curve.
    sum = 0
    for i in range(len(pts) - 1):
        pt1 = pts[i]
        pt2 = pts[i+1]
        sum += -0.5 * (pt2.Y + pt1.Y) * (pt2.X - pt1.X)
    if sum <= 0:
        return 1
    else: return -1

def OffsetCurve(C, D, P):
    accuracy = deivideAccuracy(A)
    C_len = rs.CurveLength(C)
    DividePts = rs.DivideCurve(C, round(C_len) * accuracy)
    dir = gereenEquation(DividePts)
    DivideParmers = rs.DivideCurve(C, round(C_len) * accuracy, return_points=False)
    OffsetPts = []
    for i in range(len(DivideParmers)):
        tangent = rs.CurveTangent(C, DivideParmers[i])
        direction = rs.VectorUnitize(rs.VectorCrossProduct(tangent, P.ZAxis)) * dir
        OffsetPt = DividePts[i] + direction * D
        OffsetPts.append(OffsetPt)
    OffsetPts.append(OffsetPts[0])
    polyline = rg.Polyline(OffsetPts)
    return polyline

def splitCurveBySelf(C):
    selfPaemers = gh.CurveXSelf(C)[1]
    if selfPaemers != None:
        splitCurves = gh.Shatter(C, selfPaemers)
        return splitCurves
    else:
        return [rg.PolylineCurve(C)]

def removeFasleCurves(last_Cs, Cs, D, tolerance):
    midPts = gh.CurveMiddle(Cs)
    distances = gh.CurveClosestPoint(midPts, last_Cs)[2]
    # remove open curves with near by last curves
    selectCs = []
    for i in range(len(distances)):
        if distances[i] > D - (D * tolerance):
            selectCs.append(Cs[i])
    if len(selectCs) > 1:
        selectCs = rs.JoinCurves(selectCs)
    
    # remove closed small knot curves
    validCs = []
    for i in range(len(selectCs)):
        c_len = rs.CurveLength(selectCs[i])
        if c_len > D * tolerance * 20:
            validCs.append(selectCs[i])
    return validCs




if C != None:
    if D == None or D == 0:
        D = 1
    if P == None:
        P = rs.WorldXYPlane()
    if A == None:
        A = 0.004
    
    time = 1
    IsOutput = True
    curves = []
    
    
    while IsOutput is True and time < 100:
        offsetCurve = OffsetCurve(C, D*time, P)
        splitCurves = splitCurveBySelf(offsetCurve)
        if len(splitCurves) == 1:
            curves.append(splitCurves)
        else:
            vaildCurves = removeFasleCurves(C, splitCurves, D*time, A)
            if len(vaildCurves) == 0:
                IsOutput = False
            else:
                curves.append(vaildCurves)
        time += 1
    
    
    Curves = th.list_to_tree(curves)
    Count = len(curves)
# ---------- end python ----------
panel = Panel(python.Count)

# ---- group: 偏移点+生成曲线
len = Length(Curve=crv)
multiplication_2 = Multiplication(A=len, B="5")
divide_2 = DivideCurve(Curve=crv, Count=multiplication_2, Kinks=False)  # -> Points, Tangents, Parameters
xprod = CrossProduct(VectorA=divide_2.Tangents, VectorB=Z, Unitize=True)  # -> Vector, Length
multiplication_3 = Multiplication(A=xprod.Vector, B=number_slider, C=expression)
move = Move(Geometry=divide_2.Points, Motion=multiplication_3)  # -> Geometry, Transform
pline = PolyLine(Vertices=move.Geometry, Closed=True)

# ---- group: 自交分割
cx = CurveSelf(Curve=pline)  # -> Points, Params
shatter = Shatter(Curve=pline, Parameters=cx.Params)
lng = ListLength(List=shatter)
larger = LargerThan(FirstNumber=lng, SecondNumber=0)  # -> LargerThan, OrEqualTo
group = Group(Objects=shatter)
p_n_c = PickNChoose(Pattern=larger.LargerThan, Stream0=pline, Stream1=group)
ungroup = Ungroup(Group=p_n_c)

# ---- group: 提取有效的闭合曲线
multiplication_4 = Multiplication(A=number_slider, B=Slider(0.004, range=0..0.01))
midpt = CurveMiddle(Curve=ungroup)
subtraction_2 = Subtraction(A=number_slider, B=multiplication_4)
crv_cp = CurveClosestPoint(Point=midpt, Curve=graft(crv))  # -> Point, Parameter, Distance
larger_2 = LargerThan(FirstNumber=crv_cp.Distance, SecondNumber=subtraction_2)  # -> LargerThan, OrEqualTo
dispatch = Dispatch(List=ungroup, DispatchPattern=larger_2.OrEqualTo)  # -> ListA, ListB
join = JoinCurves(Curves=dispatch.ListA, Preserve=False)
multiplication_5 = Multiplication(A=multiplication_4, B="10")
len_2 = Length(Curve=join)
larger_3 = LargerThan(FirstNumber=len_2, SecondNumber=multiplication_5)  # -> LargerThan, OrEqualTo
dispatch_2 = Dispatch(List=join, DispatchPattern=larger_3.LargerThan)  # -> ListA, ListB
crv_2 = Curve(dispatch_2.ListA)
